# Grasshopper definition Deconstruct bookWorm.gh (Grasshopper 1.0.7)
# plug-ins: Bookworm

toggle = BooleanToggle(True)
number_slider = Slider(2, range=0..10)
connumberformat = ConstructNumberFormat(NumberFormatType="1")
conpadding = ConstructPadding(Top="1")
concellborder = ConstructCellBorder(Style="5", Color=ColourSwatch(SwatchColor=RGB(0, 42, 255)))
contextformat = ConstructTextFormat(
    ForegroundColor=ColourSwatch(SwatchColor=RGB(196, 0, 255)),
    FontFamily="Arial",
    FontSize=Slider(14, range=0..100),
    Bold=toggle,
    Italic=toggle,
    Strikethrought=toggle,
    Underline=toggle,
    Link="http://parametrica.team")
contextrotation = ConstructTextRotation(Angle=Slider(41, range=0..100), Vertical=Toggle(True))
concellborders = ConstructCellBorders(BorderTop=concellborder)
number_slider_2 = Slider(500, range=0..1000)
conextendedvalue = ConstructExtendedValue(Value="Количество комнат")
concellformat = ConstructCellFormat(
    NumberFormat=connumberformat,
    Color=ColourSwatch(SwatchColor=RGB(242, 205, 94)),
    Borders=concellborders,
    Padding=conpadding,
    HorizontalAligment=number_slider,
    VerticalAligment=number_slider,
    Wrap=number_slider,
    TextDirection=Toggle(True),
    TextFormat=contextformat,
    TextRotation=contextrotation)
concell = ConstructCell(UserEnteredValue=conextendedvalue, CellFormat=concellformat)
decextendedvalue = DeconstructExtendedValue(ExtendedValue=conextendedvalue)
panel = Panel(concellformat)
panel_2 = Panel("136sKKVnzYGOcDbLzDCTKq6zVEHlm_2nUyYPIjH6f-F4")  # disabled
decell = DeconstructCell(Cell=concell)  # -> FormattedValue, UserEnteredValue, CellFormat
panel_3 = Panel(decextendedvalue)
panel_4 = Panel("Квартирография_1")  # disabled
toggle_2 = BooleanToggle(True)  # disabled
deccellformat = DeconstructCellFormat(CellFormat=decell.CellFormat)  # -> NumberFormat, Color, Borders, Padding, HorizontalAligment, VerticalAligment, Wrap, TextDirection, TextFormat, TextRotation
readcell = ReadCell(SpreadsheetId=panel_2, SheetName=panel_4, CellRange="A1:B2", Read=toggle_2, SameLength=False)  # disabled
decell_2 = DeconstructCell(Cell=readcell)  # -> FormattedValue, UserEnteredValue, CellFormat; disabled
decnumberformat = DeconstructNumberFormat(NumberFormat=deccellformat.NumberFormat)  # -> NumberFormatType, Pattern
dectextrotation = DeconstructTextRotation(TextRotation=deccellformat.TextRotation)  # -> Angle, Vertical
panel_5 = Panel(deccellformat.Color)
deccellborders = DeconstructCellBorders(Borders=deccellformat.Borders)  # -> BorderTop, BorderBottom, BorderLeft, BorderRight
panel_6 = Panel(deccellformat.HorizontalAligment)
decpadding = DeconstructPadding(Padding=deccellformat.Padding)  # -> Top, Bottom, Left, Right
panel_7 = Panel(deccellformat.VerticalAligment)
panel_8 = Panel(deccellformat.Wrap)
panel_9 = Panel(deccellformat.TextDirection)
dectextformat = DeconstructTextFormat(TextFormat=deccellformat.TextFormat)  # -> ForegroundColor, FontFamily, FontSize, Bold, Italic, Strikethrought, Underline, Link
concell_2 = ConstructCell(UserEnteredValue=decell_2.UserEnteredValue, CellFormat=decell_2.CellFormat)  # -> flatten(Cell); disabled
panel_10 = Panel("1A4-OZONXYfRZbBfHRNpN6nU8IgeaBQi29x4bGgja-Aw")  # disabled
panel_11 = Panel("3")  # disabled
toggle_3 = BooleanToggle(True)  # disabled
deccellborder = DeconstructCellBorder(Border=deccellborders.BorderTop)  # -> Style, Color
panel_12 = Panel("A1:B2")  # disabled
cull_i = CullIndex(List=concell_2, Indices=panel_11, Wrap=True)  # disabled
panel_13 = Panel(decnumberformat.Pattern)
panel_14 = Panel(decnumberformat.NumberFormatType)
panel_15 = Panel("ns gbkjh")  # disabled
panel_16 = Panel("E25:F26")  # disabled
item = ListItem(List=cull_i, Index=0, Wrap=True)  # disabled
merge = Merge(Data1=cull_i, Data2=item)  # -> flatten(Result); disabled
panel_17 = Panel("*")  # disabled
panel_18 = Panel(merge)  # disabled
nickname = UpdateCells(SpreadsheetId=panel_10, SheetName=panel_15, Cells=concell, Range=panel_16, Fields=panel_17, Run=toggle_3)  # disabled
