# Grasshopper definition create_cell.gh (Grasshopper 1.0.7)

number_slider = Slider(2, range=0..100)
c_script = CSharpScript(Style=Slider(2, range=0..10), Color=ColourSwatch(SwatchColor=RGB(255, 0, 0)))
c_script_2 = CSharpScript(
    ForegroundColor=ColourSwatch(SwatchColor=RGB(0, 0, 0)),
    FontFamily="Arial",
    FontSize=Slider(14, range=0..100),
    Bold=Toggle(False),
    Italic=Toggle(False),
    Strikethrough=Toggle(False),
    Underline=Toggle(False),
    Link="http://parametrica.team")
c_script_3 = CSharpScript(Angle=Slider(90, range=0..100), Vertical=Toggle(False))
c_script_4 = CSharpScript(Top=number_slider, Bottom=number_slider, Left=number_slider, Right=number_slider)
c_script_5 = CSharpScript(NumberFormat=c_script, Bottom=c_script, Borders=c_script, Padding=c_script)
c_script_6 = CSharpScript(
    NumberFormat=Slider(2, range=0..10),
    Color=ColourSwatch(SwatchColor=RGB(255, 0, 0)),
    Borders=c_script_5,
    Padding=c_script_4,
    HorizontalAlignment=Slider(2, range=0..100),
    VerticalAlignment=Slider(2, range=0..100),
    Wrap=Slider(2, range=0..100),
    TextDirection=Toggle(False),
    TextFormat=c_script_2,
    TextRotation=c_script_3)
c_script_7 = CSharpScript(Value="=A1+A2", CellFormat=c_script_6)
