# Grasshopper definition image.gh (Grasshopper 1.0.7)
# plug-ins: Bookworm

range = Range(Domain=Domain(0, 1), Steps=Slider(208, range=0..1000))
range_2 = Range(Domain=Domain(0, 1), Steps=Slider(85, range=0..100))
crossref = CrossReference(ListA=range_2, ListB=range, CrossMode=1)  # -> ListA, ListB
pt = ConstructPoint(XCoordinate=crossref.ListA, YCoordinate=crossref.ListB, ZCoordinate=0)
image = ImageSampler(
    pt,
    FilePath="E:\Repos\BookWorm\GH_tests\img_86x209.png",
    Filter="Colour",
    Interpolate=False,
    Umax=1,
    Umin=0,
    Vmax=1,
    Vmin=0,
    Wrap=1)
col = Colour(image)
concellformat = ConstructCellFormat(BackgroundColour=col)
panel = Panel("https://docs.google.com/spreadsheets/d/1K3s2wsVfKfw0KuZ1DzihRTXaQ1U17ud4HqVs5X2hsJ0/edit#gid=0")
conextendedvalue = ConstructExtendedValue()
concell = ConstructCell(UserEnteredValue=conextendedvalue, CellFormat=concellformat)
button = Button()
rev = ReverseList(List=concell)
writecell = WriteCells(SpreadsheetURL=panel, SheetName="Rusik", CellRange="A:CH", Cells=rev, Run=Toggle(False))
