# Grasshopper definition read_test_01.gh (Grasshopper 1.0.7)
# plug-ins: Bookworm

toggle = BooleanToggle(True)
readcellvalue = ReadCellValue(
    SpreadsheetURL="1O5K70b2fVHKrf0aMlHnd3J1Zos-jS96cUqy6KKDs6Ug",
    SheetName="Layers",
    CellRange="A:XX",
    Read=Toggle(True),
    SameLength=False)
panel = Panel(readcellvalue)
