# Grasshopper definition read_test_02.gh (Grasshopper 1.0.7)
# plug-ins: Bookworm

panel = Panel("189ivxpQlX0liyjyUpZQuqZTJNz12dlLsAD8eIfFqsVE")
toggle = BooleanToggle(True)
readcell = ReadCellRange(SpreadsheetId=panel, SheetName="Лист1", CellRange="A1:A2", Read=toggle, SameLength=False)
readcell_2 = ReadCell(SpreadsheetId=panel, SheetName="Лист1", CellRange="A1:A2", Read=toggle, SameLength=False)
panel_2 = Panel(readcell)
decell = DeconstructCell(Cell=readcell_2)  # -> FormattedValue, UserEnteredValue, CellFormat
panel_3 = Panel(decell.FormattedValue)
panel_4 = Panel(decell.UserEnteredValue)
panel_5 = Panel(decell.CellFormat)
