# Grasshopper definition write_test_01.gh (Grasshopper 1.0.7)
# plug-ins: Bookworm

panel = Panel("""Oh my God!
It Works!""")
writecellvalues = WriteCellValues(
    SpreadsheetURL="189ivxpQlX0liyjyUpZQuqZTJNz12dlLsAD8eIfFqsVE",
    SheetName="Лист1",
    CellRange="E10",
    Values=panel,
    Append=Toggle(False),
    Write=Toggle(False))
concell = ConstructCell(UserEnteredValue=panel)
writecell = WriteCells(Cells=concell, Run=False)
