# Grasshopper definition write_test_02.gh (Grasshopper 1.0.7)
# plug-ins: Bookworm

panel = Panel("https://docs.google.com/spreadsheets/d/1VB0a-8baix8UK169STamrmaPYph0ol7NBbpP4LXfrsU/edit#gid=0")
panel_2 = Panel("""fuck
you
too""")
writecellvalues = WriteCellValues(SpreadsheetURL=panel, SheetName="Лист1", CellRange="F2:G3", Values=panel_2, Append=False, Write=Toggle(True))
